# Grasshopper definition Autoswatch.gh (Grasshopper 1.0.7)
# plug-ins: Wombat

get_string = GetString(AtLeast=1, AtMost=1, Prompt="Filament Type and Name")
get_string_2 = GetString(AtLeast=1, AtMost=1, Prompt="Brand")
line = Line(Line((0, 0, 0), (0, 0, -0.8)))
txt = Text(get_string)
toggle = BooleanToggle(False)
txt_2 = Text(get_string_2)
rec = Rectangle({Plane=PlaneXY(30, 8.7, 0), Size=Domain2(u=-27.6..27.6, v=-6.3..6.3)})
boxrec = BoxRectangle(Rectangle={Plane=PlaneXY(9.3, 9.3, 0), Size=Domain2(u=-6.9..6.9, v=-6.9..6.9)}, Height=Domain(0, 2.4))
boxrec_2 = BoxRectangle(Rectangle={Plane=PlaneXY(23.1, 9.3, 0), Size=Domain2(u=-6.9..6.9, v=-6.9..6.9)}, Height=Domain(0, 1.8))
boxrec_3 = BoxRectangle(Rectangle={Plane=PlaneXY(50.7, 9.3, 0), Size=Domain2(u=-6.9..6.9, v=-6.9..6.9)}, Height=Domain(0, 0.6))
boxrec_4 = BoxRectangle(Rectangle={Plane=PlaneXY(36.9, 9.3, 0), Size=Domain2(u=-6.9..6.9, v=-6.9..6.9)}, Height=Domain(0, 1.2))
int = Integer(5)
line_2 = Line(Line((0, 0, 0), (0, 0, 3)))
rec_2 = Rectangle({Plane=PlaneXY(30, 15, 0), Size=Domain2(u=-30..30, v=-15..15)})
text2crv = TextOutlines(TextContent=txt, Plane=PlaneXY(0, 0, 0), Face="Avenir", Size=4.5, Bold=True, Italics=False)  # -> TextCurves, TextBoundingBox
text2crv_2 = TextOutlines(TextContent=txt_2, Plane=PlaneXY(0, 0, 0), Face="Avenir", Size=4.5, Bold=True, Italics=False)  # -> TextCurves, TextBoundingBox
fillet = Fillet(Curve=rec, Radius=3)
sunion = SolidUnion(Breps=[boxrec_3, boxrec_4, boxrec_2, boxrec])
dim = Dimensions(Surface=text2crv.TextBoundingBox)  # -> UDimension, expr("-x", VDimension)
dim_2 = Dimensions(Surface=text2crv_2.TextBoundingBox)  # -> UDimension, expr("-x", VDimension)
fillet_2 = Fillet(Curve=rec_2, Radius=int)
cyl = Cylinder(Base=PlaneXY(0, 0, 0), Radius=2, Length=line_2)
extrude = ExtrudeLinear(Profile=fillet, OrientationP=PlaneXY(0, 0, 0), Axis=line_2)
num2pt = NumbersToPoints(Numbers=[dim.UDimension, dim.VDimension], Mask=2)
num2pt_2 = NumbersToPoints(Numbers=[dim_2.UDimension, dim_2.VDimension], Mask=2)
extrude_2 = ExtrudeLinear(Profile=fillet_2, OrientationP=PlaneXY(0, 0, 0), Axis=line_2)
move = Move(Geometry=cyl, Motion=Vector(5, 25, 0))  # -> Geometry, Transform
cap = CapHoles(Brep=extrude)
ln = Line(StartPoint=num2pt, EndPoint=Point(56.4, 16.4, 3))
move_2 = Move(Geometry=text2crv.TextCurves, Motion=ln)  # -> Geometry, Transform
ln_2 = Line(StartPoint=num2pt_2, EndPoint=Point(56.4, 23, 3))
move_3 = Move(Geometry=text2crv_2.TextCurves, Motion=ln_2)  # -> Geometry, Transform
cap_2 = CapHoles(Brep=extrude_2)
boundary = BoundarySurfaces(Edges=move_3.Geometry)
sdiff = SolidDifference(BrepsA=cap, BrepsB=sunion)
boundary_2 = BoundarySurfaces(Edges=move_2.Geometry)
sdiff_2 = SolidDifference(BrepsA=cap_2, BrepsB=move.Geometry)
extrude_3 = ExtrudeLinear(Profile=[boundary_2, boundary], OrientationP=PlaneXY(0, 0, 0), Axis=line)
filedge = FilletEdge(Shape=sdiff_2, Blend=1, Metric=0, Edges=[1, 2, 3, 5], Radii=0.8)
sdiff_3 = SolidDifference(BrepsA=filedge, BrepsB=sdiff)
debrep = DeconstructBrep(Brep=sdiff_3)  # -> Faces, Edges, Vertices
filedge_2 = FilletEdge(Shape=sdiff_3, Blend=1, Metric=0, Edges=14, Radii=0.4)
curvepoint = PointOnCurve(debrep.Edges, parameter=0.68)
sdiff_4 = SolidDifference(BrepsA=filedge_2, BrepsB=extrude_3)
context_bake = ContextBake(Geometry=sdiff_4)
points = PointList(Points=curvepoint, Size=Slider(1, range=0..1))
